# Grasshopper definition HoloFab_Testing.gh (Grasshopper 1.0.7)
# plug-ins: MeshEdit Components, treesloth01, HoloFab

panel = Panel("199.5.81.93")
panel_2 = Panel("192.168.1.112")
panel_3 = Panel("199.5.80.149")
panel_4 = Panel("199.5.81.253")
create_connection = CreateConnection(Address="192.168.1.137")
number_slider = Slider(426, range=0..1000)  # disabled
number_slider_2 = Slider(0, range=0..1000)
xy = XYPlane(Origin=Point(0, 0, 0))  # disabled
xz = XZPlane(Origin=Point(0, 0, 0))  # disabled
number_slider_3 = Slider(113, range=0..1000)
item = ListItem(Index=0, Wrap=True)  # -> Item, Item1
ui_receiver = UIReceiver(Connect=create_connection)  # -> Toggles, Counters, Sliders
number_slider_4 = Slider(5, range=3..10)
rectangle = Rectangle(Plane=xy, XSize=number_slider, YSize=number_slider, Radius=0)  # -> Rectangle, Length; disabled
number_slider_5 = Slider(10, range=3..10)
multiplication = Multiplication(A=item.Item, B=100)
robot = ValueList({"Choose Robot", "KR150-2_110", "IRB140", "IRB120"}, selected="IRB140")
robot_2 = ValueList({"Choose Robot", "KR150-2_110", "IRB140", "IRB120"}, selected="IRB120")
genes = GenePool(Decimals=3, Maximum=3.141, Minimum=0, Value=[1.158, 2.627, 0, 0, 0.847, 0.395])
genes_2 = GenePool(Decimals=3, Maximum=3.141, Minimum=0, Value=[1.87, 1.514, 1.753, 1.542, 0.5915926038, 2.364536335])
rectangle_2 = Rectangle(Plane=PlaneXY(0, 0, 0), XSize=number_slider_2, YSize=number_slider_2, Radius=0)  # -> Rectangle, Length; disabled
pt = ConstructPoint(XCoordinate=0, YCoordinate=0, ZCoordinate=number_slider_2)
panel_5 = Panel("1")  # disabled
panel_6 = Panel(ui_receiver.Counters)
panel_7 = Panel(ui_receiver.Toggles)
panel_8 = Panel(ui_receiver.Sliders)
pt_2 = ConstructPoint(XCoordinate=Slider(-324, range=-1000..1000), YCoordinate=Slider(0, range=0..1000), ZCoordinate=Slider(0, range=0..1000))
pt_3 = ConstructPoint(XCoordinate=Slider(0, range=0..1000), YCoordinate=Slider(1000, range=0..1000), ZCoordinate=Slider(0, range=0..1000))
swatch = ColourSwatch(SwatchColor=RGB(66, 72, 252))
mplane = MeshPlane(Boundary=rectangle.Rectangle, WidthCount=panel_5, HeightCount=panel_5)  # -> Mesh, Area; disabled
panel_9 = Panel("1")  # disabled
msphereex = MeshSphereEx(Base=PlaneXY(0, 0, 0), Radius=number_slider_3, Count=5)  # disabled
msphere = MeshSphere(Base=PlaneXY(0, 0, 0), Radius=number_slider_3, UCount=number_slider_4, VCount=number_slider_4)
sph = Sphere(Base=PlaneXY(0, 0, 0), Radius=number_slider_3)  # disabled
swatch_2 = ColourSwatch(SwatchColor=RGBA(255, 0, 0, 122))
pt_4 = ConstructPoint(XCoordinate=0, YCoordinate=0, ZCoordinate=Slider(522, range=0..1000))
msphere_2 = MeshSphere(Base=pt, Radius=Slider(100, range=0..100), UCount=number_slider_5, VCount=number_slider_5)
mplane_2 = MeshPlane(Boundary=rectangle_2.Rectangle, WidthCount=panel_9, HeightCount=panel_9)  # -> Mesh, Area; disabled
stack = StackTrees(Data0=genes, Data1=genes_2, Reduce=True)
flip = MeshFlip(Mesh=msphere)  # disabled
flip_2 = MeshFlip(Mesh=mplane_2.Mesh)  # disabled
hb = HoloBot(Name=robot_2, EndEffector=msphere_2, ID=0, Plane=pt_2)
hb_2 = HoloBot(Name=robot, EndEffector=msphere_2, ID="1", Plane=pt_3)
swatch_3 = ColourSwatch(SwatchColor=RGBA(255, 0, 0, 118))
ht = HoloTag(TextString="Hello World!", TextLocation=pt_4, TextSize=20, TextColor=RGB(255, 255, 255), Connect=create_connection)
mesh = Mesh(msphere)
custom_preview = CustomPreview(Geometry=msphere_2, Material=swatch_2)
demesh = DeconstructMesh(Mesh=mesh)  # -> Vertices, Faces, Colours, Normals
ms = MeshStreaming(Mesh=msphere_2, Color=swatch_2, Connect=create_connection)
booleans = Data()
pi = Pi(Factor=1)
sliders = Data()
mcol = MeshColours(Mesh=mesh, Colours=demesh.Normals)
item_2 = ListItem(List=booleans, Index="0", Wrap=True)
remap = RemapNumbers(Value=sliders, Source=Domain(0, 1), Target=pi)  # -> Mapped, Clipped
axis_by_branches = Data(stack)
filter = StreamFilter(Gate=item_2, Stream0=hb, Stream1=hb_2)
custom_preview_2 = CustomPreview(Geometry=mesh, Material=swatch_3)
ms_2 = MeshStreaming(Mesh=mesh, Color=swatch_3, Connect=create_connection)
rs = RobotStreaming(HoloBotS=[hb_2, hb], Connect=create_connection)  # disabled
rc = RobotController(HoloBot=[hb, hb_2], AxisValues=axis_by_branches, Connect=create_connection)  # disabled
rc_2 = RobotController(HoloBot=filter, AxisValues=remap.Mapped, Connect=create_connection)  # disabled
